# Dynamo graph isolate mirrored items_script.dyn (Dynamo 2.12.0.5650)
# packages: Clockwork for Dynamo 2.x 2.3.0, Rhythm 2022.4.3, Data-Shapes 2022.2.103

categories = Categories("OST_Windows")
string = StringInput("Isolate Mirrored Elements")
file_path = Filename("..\..\..\..\..\Misc. Project Files\Dynamo\primedesignlogo.jfif")
string_2 = StringInput("Make it so")
string_3 = StringInput("Select Category")
boolean = BoolSelector(false)
textbox_data = Custom[TextBox Data](InputName=string_3, IsNumberEntry=boolean)  # package Data-Shapes; Create Data for TextBox input in UI.MultipleInputForm ++ . Check out www.data-shapes.net for more informations
boolean_2 = BoolSelector(true)
file_path_2 = Filename("G:\Shared drives\PRIME DESIGN\REFERENCE LIBRARY\Revit Category Guide.xlsx")
code_block = CodeBlock { "Cancel"; 900; 700; 300; }
multipleinputform = Custom[MultipleInputForm ++](Description_optional=string, Logo_optional=file_path, ButtonText_optional=string_2, Inputs=textbox_data, Toggle=boolean_2, LinkToHelp_optional=file_path_2, CancelButtonText_optional=code_block.out0, MaxHeight_optional=code_block.out1, Width_optional=code_block.out2, LabelWidth_optional=code_block.out3)  # package Data-Shapes; Create a form with multiple inputs. see www.data-shapes.net for tutorials and infos!
byName = Category.ByName(name=multipleinputform.User_Inputs)
all_elements_of_category = ElementsOfCategory(Category=byName)
isMirrored = Custom[FamilyInstance.IsMirrored](familyInstance=all_elements_of_category@L2)  # package Clockwork for Dynamo 2.x; Checks if a family instance is mirrored
filterByBoolMask = List.FilterByBoolMask(list=all_elements_of_category, mask=isMirrored)

# group: Add 'Mirrored' to mirrored items
watch = Watch(filterByBoolMask.out)
code_block_2 = CodeBlock { "Comments"; }
code_block_3 = CodeBlock { "Mirrored"; }
ʳʰʸᵗʰᵐ_elements = Rhythm.Revit.Elements.Elements.SetParameterValueByNameCaSeiNSeNSiTiVe(element=watch, parameterName=code_block_2, value=code_block_3)

# group: Clearing comment on not mirrored items
watch_2 = Watch(filterByBoolMask.in)
code_block_4 = CodeBlock { "Comments"; }
code_block_5 = CodeBlock { " "; }
ʳʰʸᵗʰᵐ_elements_2 = Rhythm.Revit.Elements.Elements.SetParameterValueByNameCaSeiNSeNSiTiVe(element=watch_2, parameterName=code_block_4, value=code_block_5)
